# Grasshopper definition UnconventionalDatasets.gh (Grasshopper 1.0.7)
# plug-ins: Human

layertable = LayerTable(Update=Toggle(True), AutoUpdate=False)  # -> Layers, FullLayerPaths, LayerColors, Linetypes, MaterialNames, Visible, PrintWidth, PrintColor
dpipeline = DynamicGeometryPipeline(
    LayerFilter=layertable.Layers,
    TypeFilter="All",
    NameFilter="*",
    GroupByLayer=False,
    GroupByType=False,
    IncludeHidden=True,
    IncludeLocked=True,
    enableFullPath=False,
    listenToAttributes=True)
toggle = BooleanToggle(True)
objatts = ObjectAttributes(ObjectOrAttributes=dpipeline)  # -> Name, LayerName, LayerFullPath, Color, MaterialName, LinetypeName, GroupIndices, PlotWeight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
clean = CleanTree(RemoveNulls=toggle, RemoveInvalid=True, RemoveEmpty=toggle, Tree=dpipeline)
